# Grasshopper definition boxes.gh (Grasshopper 1.0.7)

# ---- group: RH_IN:boxes
number_slider = Slider(500, range=0..500)

# ---- group: RH_IN:scale
number_slider_2 = Slider(5, range=0..10)

# ----
box = CenterBox(Base=PlaneXY(0, 0, 0), X=Slider(100, range=0..100), Y=Slider(100, range=0..100), Z=Slider(100, range=0..100))
pop3d = Populate3D(Region=box, Count=number_slider, Seed=1)
box_2 = CenterBox(Base=pop3d, X=number_slider_2, Y=number_slider_2, Z=number_slider_2)
dom = ConstructDomain(DomainStart=Slider(0, range=0..100), DomainEnd=Slider(10, range=0..10))
area = Area(Geometry=box_2)  # -> Area, Centroid
range = Range(Domain=dom, Steps=expr("x-1", number_slider))
graph = GraphMapper(
    range,
    x0=0,
    x1=1,
    y0=0,
    y1=1,
    container_name="Bezier",
    cpx=[0, 0.3825692534, 0.8881092668, 1],
    cpy=[0.3109701276, 0.09736126661, 0.2540079951, 0.9731571078])
scale = Scale(Geometry=box_2, Center=area.Centroid, Factor=graph)  # -> Geometry, Transform

# ---- group: RH_OUT:mesh
mesh = Mesh(scale.Geometry)
