# Grasshopper definition column.gh (Grasshopper 1.0.7)

# ---- group: RH_IN:Height
height = Slider(2.6, range=0..4)

# ---- group: RH_IN:Angle
angle = Slider(10, range=-10..10)

# ---- group: RH_IN:Scale
scale = Slider(10, range=0..10)

# ----
number_slider = Slider(0.1, range=0..2)
division = Division(A=height, B=number_slider)
series = Series(Start=0, Step=number_slider, Count=expr("x+1", division))
cir = Circle(Plane=PlaneXY(0, 0, 0), Radius=1)
crv = Curve(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)
dom = ConstructDomain(DomainStart=Slider(0, range=0..10), DomainEnd=scale)
Z = UnitZ(Factor=series)
range = Range(Domain=dom, Steps=expr("x-1", division))
series_2 = Series(Start=0, Step=angle, Count=expr("x+1", division))
line = LineSDL(Start=cir, Direction=Vector(0, 0, 1), Length=1)
move = Move(Geometry=cir, Motion=Z)  # -> Geometry, Transform
move_2 = Move(Geometry=crv, Motion=Z)  # -> Geometry, Transform
graph = GraphMapper(
    range,
    x0=0,
    x1=1,
    y0=0,
    y1=1,
    container_name="Bezier",
    cpx=[0, 0.7606873512, 0.6804508567, 1],
    cpy=[0.8059307337, 0.1078725457, 0.8380259275, 0.3485819697])
area = Area(Geometry=move.Geometry)  # -> Area, Centroid
rotax = RotateAxis(Geometry=move_2.Geometry, Angle=degrees(series_2), Axis=line)  # -> Geometry, Transform
scale_2 = Scale(Geometry=move_2.Geometry, Center=area.Centroid, Factor=graph)  # -> Geometry, Transform
merge = Merge(Data1=graft(rotax.Transform), Data2=graft(scale_2.Transform))
comp = Compound(Transforms=merge)  # -> flatten(Compound)
transform = Transform(Geometry=move_2.Geometry, Transform=comp)
Z_2 = UnitZ(Factor=Slider(0.01, range=0..0.01))
scale_3 = Scale(Geometry=transform, Center=area.Centroid, Factor=Slider(0.8, range=0..1))  # -> Geometry, Transform
extr = Extrude(Base=transform, Direction=Z_2)
divide = DivideCurve(Curve=scale_3.Geometry, Count=10, Kinks=False)  # -> Points, Tangents, Parameters
flip = FlipMatrix(Data=divide.Points)
cap = CapHoles(Brep=extr)
intcrv = Interpolate(Vertices=flip, Degree=3, Periodic=False, KnotStyle=1)  # -> flatten(Curve), Length, Domain
path_mapper = PathMapper(cap, source="{A;B}", target="{A}")
pipe = Pipe(Curve=intcrv.Curve, Radius=Slider(0.005, range=0..0.1), Caps=1)  # -> flatten(Pipe)
merge_2 = Merge(Data1=path_mapper, Data2=pipe)
loft = Loft(Curves=transform, Options={Adjust=False, Closed=False, LoftEnds=0, LoftSimp=0, LoftType=0, Rebuild=10, Refit=0.01})

# ---- group: RH_IN:skeleton
bool = Boolean(False)

# ----
filter = StreamFilter(Gate=bool, Stream0=loft, Stream1=merge_2)

# ---- group: RH_OUT:mesh
mesh = Mesh(filter)
